# Grasshopper definition MIS_example.gh (Grasshopper 1.0.8)

pt = ConstructPoint(XCoordinate=0, YCoordinate=0, ZCoordinate=0)
Y = UnitY(Factor=1)
line = LineSDL(Start=pt, Direction=Y, Length=10)
X = UnitX(Factor=1)
arrlinear = LinearArray(Geometry=line, Direction=X, Count=7)  # -> Geometry, Transform
py3 = Python3Script(curves=arrlinear.Geometry, dist="1.5")  # -> kept; inputs curves: list of Curve, dist: Double
# ---------- py3: Python ----------
from Curve_Removal import MIS_curves

keep = []
kept, removed, test = MIS_curves.main(curves, dist, keep)

from ghpythonlib import treehelpers as tr
kept = tr.list_to_tree(kept)
# ---------- end py3 ----------
crv = Curve(py3)
