# Grasshopper definition PSL_TracerABC_example.gh (Grasshopper 1.0.8)
# plug-ins: Karamba3D, Pufferfish, eleFront

crv = Curve(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)
boundary = BoundarySurfaces(Edges=crv)
mesh_uv = MeshSurface(Surface=boundary, UCount="80", VCount="80", Overhang=True, Equalize=False)
crv_2 = Curve(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)
pipe = Pipe(Curve=crv_2, Radius=0.1, Caps=0)
preview = CustomPreview(Geometry=pipe, Material=ColourSwatch(SwatchColor=RGB(0, 0, 0)))
explode = Explode(Curve=crv_2, Recursive=True)  # -> Segments, Vertices
boundary_2 = BoundarySurfaces(Edges=crv_2)
disc = Discontinuity(Curve=crv_2, Level=1)  # -> Points, Parameters

medges = MeshEdges(Mesh=mesh_uv)  # -> NakedEdges, InteriorEdges, NonManifoldEdges
nv = NakedVertices(Mesh=mesh_uv)  # -> ClothedIndex, NakedIndex, ClothedPts, NakedPts
vertexloads = VertexLoads(Mesh=mesh_uv, Strength="-0.0000001")
crv_3 = Curve(medges.InteriorEdges)
anchor = Anchor(Point=nv.NakedPts, Strength=10000)
len = Length(Curve=crv_3)
show = Show(G=mesh_uv)
multiplication = Multiplication(A=len, B=Slider(0.27, range=0..0.9))
length_line = LengthLine(Line=crv_3, Length=multiplication, Strength=10)
entwine = Entwine(Branch00=show, Branch01=length_line, Branch02=anchor, Branch03=vertexloads, FlattenInputs=True)

midpt = CurveMiddle(Curve=explode.Segments)
mesh_uv_2 = MeshSurface(Surface=boundary_2, UCount="80", VCount="80", Overhang=True, Equalize=False)
crv_cp = CurveClosestPoint(Point=midpt, Curve=explode.Segments)  # -> Point, Parameter, Distance
shatter = Shatter(Curve=explode.Segments, Parameters=crv_cp.Parameter)
item = ListItem(List=shatter, Index=0, Wrap=True)

medges_2 = MeshEdges(Mesh=mesh_uv_2)  # -> NakedEdges, InteriorEdges, NonManifoldEdges
nv_2 = NakedVertices(Mesh=mesh_uv_2)  # -> ClothedIndex, NakedIndex, ClothedPts, NakedPts
vertexloads_2 = VertexLoads(Mesh=mesh_uv_2, Strength="-0.1")
crv_4 = Curve(medges_2.InteriorEdges)
anchor_2 = Anchor(Point=nv_2.NakedPts, Strength=10000)
len_2 = Length(Curve=crv_4)
show_2 = Show(G=mesh_uv_2)
multiplication_2 = Multiplication(A=len_2, B=Slider(0.27, range=0..0.9))
length_line_2 = LengthLine(Line=crv_4, Length=multiplication_2, Strength=10)
entwine_2 = Entwine(Branch00=show_2, Branch01=length_line_2, Branch02=anchor_2, Branch03=vertexloads_2, FlattenInputs=True)

divlength = DivideLength(Curve=item, Length="5")  # -> Points, Tangents, Parameters
solver = Solver(GoalObjects=entwine, Reset=Button(), Threshold=1e-15, Tolerance=0.0001, On=Toggle(False))  # -> I, V, O
formfound_mesh = ExplodeTree(Data=solver.O)
dam = DataDam(DataA=formfound_mesh, BufferDelay=10000000, BufferMode=0)
solver_2 = Solver(GoalObjects=entwine_2, Reset=Button(), Threshold=1e-15, Tolerance=0.0001, On=Toggle(False))  # -> I, V, O
formfound_mesh_2 = ExplodeTree(Data=solver_2.O)
dam_2 = DataDam(DataA=formfound_mesh_2, BufferDelay=10000000, BufferMode=0)
mesh = Mesh(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)
mesh_2 = Mesh(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)

number_slider = Slider(-2, range=-10..0)
nv_3 = NakedVertices(Mesh=mesh)  # -> ClothedIndex, NakedIndex, ClothedPts, NakedPts
Z = UnitZ(Factor="-0.1")
matprops = MaterialPropertiesKaramba3D(
    FamilyOfMaterial="Steel",
    Name="S235",
    YoungsModulus_kN_cm²="3",
    InPlaneShearModulus_kN_cm²="1.4",
    TransverseShearModulus_kN_cm²="1.4",
    SpecificWeight_kN_m³="1",
    CoefficientOfThermalExpansion_1=1.2e-05,
    TensileStrength_kN_cm²=23.5,
    CompressiveStrength_kN_cm²=-23.5,
    StrengthHypothesis="MISES",
    mode="Isotrop")
supp = SupportKaramba3D(PosInd=nv_3.NakedPts, Ct_kN_m=Vector(0, 0, 0), Cr_kNm_rad=Vector(0, 0, 0), menu=[buttons(on, on, on, off, off, off)])
loads = LoadsKaramba3D(Vector=Z, Mesh=mesh, LCase="LC0", mode="MeshLoad -Const.", menu=[buttons(off, on, off), buttons(on, on)])
loads_2 = LoadsKaramba3D(Eps0="-2", LCase="LC0", mode="InitialStrain")
crosec = CrossSectionKaramba3D(FamilyNameOfCrossSection="DefaultCroSec", Material=matprops, Height_cm="0.3", mode="Shell - Const")
load = LoadKaramba3D([loads, loads_2])
surfelem = CreateSurfaceElementKaramba3D(Mesh=mesh, CrossSection=crosec, LimitDistance_m=0.005, Bending=False, mode="MeshToMembrane")  # -> Element, Points, Info
assemble = AssembleModelKaramba3D(Elem=flatten(surfelem.Element), Support=flatten(supp), Load=flatten(load), LimitDistance_cm=0.005)  # -> Model, Info, Mass_kg, CentreOfGravity, LoadCaseNames

nv_4 = NakedVertices(Mesh=mesh_2)  # -> ClothedIndex, NakedIndex, ClothedPts, NakedPts
Z_2 = UnitZ(Factor=Slider(-2, range=-10..0))
matprops_2 = MaterialPropertiesKaramba3D(
    FamilyOfMaterial="Steel",
    Name="S235",
    YoungsModulus_kN_cm²="3",
    InPlaneShearModulus_kN_cm²="1.4",
    TransverseShearModulus_kN_cm²="1.4",
    SpecificWeight_kN_m³="1",
    CoefficientOfThermalExpansion_1=1.2e-05,
    TensileStrength_kN_cm²=23.5,
    CompressiveStrength_kN_cm²=-23.5,
    StrengthHypothesis="MISES",
    mode="Isotrop")
supp_2 = SupportKaramba3D(PosInd=nv_4.NakedPts, Ct_kN_m=Vector(0, 0, 0), Cr_kNm_rad=Vector(0, 0, 0), menu=[buttons(on, on, on, off, off, off)])
loads_3 = LoadsKaramba3D(Vector=Z_2, Mesh=mesh_2, LCase="LC0", mode="MeshLoad -Const.", menu=[buttons(off, on, off), buttons(on, on)])
loads_4 = LoadsKaramba3D(Eps0="-2", LCase="LC0", mode="InitialStrain")
crosec_2 = CrossSectionKaramba3D(FamilyNameOfCrossSection="DefaultCroSec", Material=matprops_2, Height_cm="0.3", mode="Shell - Const")
load_2 = LoadKaramba3D([loads_3, loads_4])
surfelem_2 = CreateSurfaceElementKaramba3D(Mesh=mesh_2, CrossSection=crosec_2, LimitDistance_m=0.005, Bending=False, mode="MeshToMembrane")  # -> Element, Points, Info
assemble_2 = AssembleModelKaramba3D(Elem=flatten(surfelem_2.Element), Support=flatten(supp_2), Load=flatten(load_2), LimitDistance_cm=0.005)  # -> Model, Info, Mass_kg, CentreOfGravity, LoadCaseNames

panel = Panel("-0.1")
license = LicenseKaramba3D()
analysethii = AnalyseThIIKaramba3D(
    Model=assemble.Model,
    UseInitialNII=True,
    NIIFromCombination=True,
    NoTensionalNII=False,
    RTolerance=1e-07,
    MaxIterations=50)  # -> AnalysedModel, MaximumDisplacement_cm, ResultingForce_kN, ChangeOfElasticEnergy_kNm
license_2 = LicenseKaramba3D()
analysethii_2 = AnalyseThIIKaramba3D(
    Model=assemble_2.Model,
    UseInitialNII=True,
    NIIFromCombination=True,
    NoTensionalNII=False,
    RTolerance=1e-07,
    MaxIterations=50)  # -> AnalysedModel, MaximumDisplacement_cm, ResultingForce_kN, ChangeOfElasticEnergy_kNm
shellview = ShellViewKaramba3D(Model=analysethii_2.AnalysedModel, IndexOfLayer=0)  # -> Model, MeshesOfRenderedShells, LegendColours, LegendTags
modelview = ModelViewKaramba3D(Model=analysethii.AnalysedModel)  # -> Model, DeformedMesh, DeformedAxes, DeformedModel, MaximumDeformation
shellview_2 = ShellViewKaramba3D(Model=analysethii.AnalysedModel, IndexOfLayer=0)  # -> Model, MeshesOfRenderedShells, LegendColours, LegendTags
shellvecresults = ResultVectorsOnShellsKaramba3D(Model=analysethii_2.AnalysedModel, LayerPosition=0, mode="PrincStress")  # -> Model, Points, FirstPrincipalStressVector_kN_cm², SecondPrincipalStressVector_kN_cm², FirstPrincipalStressValue_kN_cm², SecondPrincipalStressValue_kN_cm²
s_forces = ShellForcesKaramba3D(AnalysedModel=analysethii_2.AnalysedModel, mode="Principal")  # -> Model, expr("x*100", flatten(FirstPrincipalNormalForce_kN_m)), expr("x*100", flatten(SecondPrincipalNormalForce_kN_m)), FirstPrincipalMoment_kNm_m, SecondPrincipalMoment_kNm_m, ShearForceInLocalXDirection_kN_m, ShearForceInLocalYDirection_kN_m, LoadCaseIndex
modelview_2 = ModelViewKaramba3D(Model=analysethii_2.AnalysedModel)  # -> Model, DeformedMesh, DeformedAxes, DeformedModel, MaximumDeformation
legend = Legend(
    Colour=shellview_2.LegendColours,
    Tags=shellview_2.LegendTags,
    Rectangle={Plane=PlaneXY(346, 100, 0), Size=Domain2(u=-25..25, v=-100..100)},
    LegendType=1)
textdot = DefineTextDot(Text=s_forces.FirstPrincipalNormalForce_kN_m, Location=shellvecresults.Points, Font="Arial", Size=9)
bnd = Bounds(Numbers=s_forces.FirstPrincipalNormalForce_kN_m)
shellvecresults_2 = ResultVectorsOnShellsKaramba3D(Model=analysethii.AnalysedModel, LayerPosition=0, mode="PrincStress")  # -> Model, Points, FirstPrincipalStressVector_kN_cm², SecondPrincipalStressVector_kN_cm², FirstPrincipalStressValue_kN_cm², SecondPrincipalStressValue_kN_cm²
legend_2 = Legend(
    Colour=shellview.LegendColours,
    Tags=shellview.LegendTags,
    Rectangle={Plane=PlaneXY(70, -35, 0), Size=Domain2(u=-7..7, v=-30..30)},
    LegendType=1)
md_slider = MDSlider(
    SliderMode=0,
    slider_value=Point(0.05455947504, 0.4982329423, 0.5),
    x_domain=Domain(0, 1),
    y_domain=Domain(0, 1),
    z_domain=Domain(0, 1))
mesh_3 = Mesh(mesh)
area = Area(Geometry=boundary)  # -> Area, Centroid
debrep = DeconstructBrep(Brep=boundary)  # -> Faces, Edges, Vertices
msh2psrf = MeshToPolysurface(Mesh=mesh_3, Triangles=False, FaceMerge=False)
midpt_2 = CurveMiddle(Curve=debrep.Edges)
mesh_4 = Mesh(mesh_2)
md_slider_2 = MDSlider(
    SliderMode=0,
    slider_value=Point(0.05573849562, 0.4963306799, 0.5),
    x_domain=Domain(0, 1),
    y_domain=Domain(0, 1),
    z_domain=Domain(0, 1))
evalsrf = EvaluateSurface(Surface=reparameterize(msh2psrf), Point=md_slider)  # -> Point, Normal, UDirection, VDirection, Frame
ln = Line(StartPoint=area.Centroid, EndPoint=midpt_2)
msh2psrf_2 = MeshToPolysurface(Mesh=mesh_4, Triangles=False, FaceMerge=False)
divide = DivideCurve(Curve=ln, Count=10, Kinks=False)  # -> Points, Tangents, Parameters
project = ProjectPoint(Point=evalsrf.Point, Direction=Vector(0, 0, -1), Geometry=msh2psrf)  # -> Point, Index
evalsrf_2 = EvaluateSurface(Surface=reparameterize(msh2psrf_2), Point=md_slider_2)  # -> Point, Normal, UDirection, VDirection, Frame
cull_i = CullIndex(List=divide.Points, Indices=[0, -1], Wrap=True)
crv_5 = Curve(crv)
project_2 = ProjectPoint(Point=evalsrf_2.Point, Direction=Vector(0, 0, -1), Geometry=msh2psrf_2)  # -> Point, Index
sph = Sphere(Base=project_2.Point, Radius=0.6)
explode_2 = Explode(Curve=crv_5, Recursive=True)  # -> Segments, Vertices
preview_2 = CustomPreview(Geometry=sph, Material=ColourSwatch(SwatchColor=RGB(0, 0, 0)))
crv_6 = Curve(crv_2)
explode_3 = Explode(Curve=crv_6, Recursive=True)  # -> Segments, Vertices

tracer_b = Python3Script(
    seed_point=project.Point,
    principal_vectors=shellvecresults_2.FirstPrincipalStressVector_kN_cm²,
    points=shellvecresults_2.Points,
    domain_surface=msh2psrf,
    boundary_curves=explode_2.Segments)  # -> psl, connect, valid_seeds; inputs seed_point: Point3d, principal_vectors: list of Vector3d, points: list of Point3d, domain_surface: Brep, boundary_curves: list of Curve
# ---------- tracer_b: Python ----------
from PSL_Tracer import Tracer_B


#BASIC
h = 0.4                         #Step length
num_steps = 1000                #Max iterations
k = 15                          #Interpolation amount
collision_threshold = 1.0      #Distance constraint
snap_radius = 1                 #Snapping radius
n_back = 5                      #Steps back when merging
offset_distance = 3             #Offset distance
sample_interval = 2             #Sampling for offsets

sample_count = 300              #Sampling boundaries for edge connection 
k_edge = 30                     #Edge connection considerations
ratio_minseed_coll = 2.5       #Ratio between min_seed_distance and collision_threshold   min_seed_distance = collision_threshold * ratio




psl, connect, valid_seeds= Tracer_B.main(h,num_steps,k,collision_threshold,snap_radius,n_back,offset_distance,sample_interval,sample_count,k_edge,ratio_minseed_coll,seed_point,principal_vectors,points,domain_surface,boundary_curves)
# ---------- end tracer_b ----------
tracer_a = Python3Script(
    seed_points=flatten(cull_i),
    principal_vectors=shellvecresults_2.SecondPrincipalStressVector_kN_cm²,
    points=shellvecresults_2.Points,
    domain_surface=msh2psrf,
    boundary_curves=explode_2.Segments)  # -> a, b; inputs seed_points: list of Point3d, principal_vectors: list of Vector3d, points: list of Point3d, domain_surface: Brep, boundary_curves: list of Curve
# ---------- tracer_a: Python ----------
from PSL_Tracer import Tracer_A

#Variables
h = 0.5                     #step length
num_steps=400               #Max Iterations
k=15                        #k nearest neighbours for interpolation
collision_threshold=1       #distance constraint
merge_radius = 5            #snapping radius
n_back = 5                  #Steps back when merging
sample_count = 500          #Sampling boundaries for edge connection
k_edge = 30                 #edge connection considerations



a,b = Tracer_A.main(h,num_steps,k,collision_threshold,merge_radius,n_back,sample_count,k_edge,seed_points,principal_vectors,points,domain_surface,boundary_curves)
# ---------- end tracer_a ----------
tracer_c = Python3Script(
    seed_point=project_2.Point,
    principal_vectors=shellvecresults.FirstPrincipalStressVector_kN_cm²,
    points=shellvecresults.Points,
    domain_surface=msh2psrf_2,
    boundary_curves=explode_3.Segments,
    stress_values=s_forces.FirstPrincipalNormalForce_kN_m)  # -> a, b, c; inputs seed_point: list of Point3d, principal_vectors: list of Vector3d, points: list of Point3d, domain_surface: Brep, boundary_curves: list of Curve, stress_values: list of Double
# ---------- tracer_c: Python ----------
# variables
h = 0.4
num_steps = 1000
k = 15
collision_threshold = 1.0
max_offset_distance = 8
n_back = 5
strength = 250
snap_radius = 1
sample_count = 300
ratio_minseed_coll = 2
sample_interval = 2



from PSL_Tracer import Tracer_C



a, b ,c = Tracer_C.main(ghenv,h,num_steps,k,collision_threshold,snap_radius,n_back,max_offset_distance,sample_interval,sample_count,ratio_minseed_coll,seed_point,principal_vectors,points,domain_surface,boundary_curves,strength,stress_values)
# ---------- end tracer_c ----------

crv_7 = Curve(reparameterize(tracer_c.a))
pt = Point(project_2.Point)
pt_2 = Point(tracer_c.c)
explode_4 = Explode(Curve=crv_7, Recursive=True)  # -> Segments, Vertices
ins = InsertItems(List=pt_2, Item=pt, Indices=0, Wrap=True)
intcrv = Interpolate(Vertices=explode_4.Vertices, Degree=3, Periodic=False, KnotStyle=1)  # -> reparameterize(flatten(Curve)), Length, Domain
crv_cp_2 = CurveClosestPoint(Point=ins, Curve=intcrv.Curve)  # -> Point, Parameter, Distance
crv_8 = Curve(reparameterize(tracer_b.psl))
pt_3 = Point(project.Point)
sph_2 = Sphere(Base=pt_3, Radius=0.6)
pt_4 = Point(tracer_b.valid_seeds)
pframe = PerpFrame(Curve=intcrv.Curve, Parameter=crv_cp_2.Parameter)
preview_3 = CustomPreview(Geometry=sph_2, Material=ColourSwatch(SwatchColor=RGB(0, 0, 0)))
ins_2 = InsertItems(List=pt_4, Item=pt_3, Indices=0, Wrap=True)
explode_5 = Explode(Curve=crv_8, Recursive=True)  # -> Segments, Vertices
cir = Circle(Plane=pframe, Radius=1)
intcrv_2 = Interpolate(Vertices=explode_5.Vertices, Degree=3, Periodic=False, KnotStyle=1)  # -> reparameterize(flatten(Curve)), Length, Domain
crv_cp_3 = CurveClosestPoint(Point=ins_2, Curve=intcrv_2.Curve)  # -> Point, Parameter, Distance
boundary_3 = BoundarySurfaces(Edges=cir)
split = SplitWithBrep(Curve=intcrv.Curve, Brep=boundary_3)  # -> Curve, Points
pframe_2 = PerpFrame(Curve=intcrv_2.Curve, Parameter=crv_cp_3.Parameter)
graft = GraftTree(Tree=split.Curve, IncludeEmptyLists=True, IncludeNullItems=True)
divlength_2 = DivideLength(Curve=graft, Length=0.4)  # -> simplify(Points), Tangents, Parameters
cir_2 = Circle(Plane=pframe_2, Radius=1)
split_2 = SplitTree(Data=divlength_2.Points, Masks=flatten("{*;0}"))  # -> Positive, Negative
boundary_4 = BoundarySurfaces(Edges=cir_2)
split_3 = SplitWithBrep(Curve=intcrv_2.Curve, Brep=boundary_4)  # -> Curve, Points
rev = ReverseList(List=split_2.Positive)
graft_2 = GraftTree(Tree=split_3.Curve, IncludeEmptyLists=True, IncludeNullItems=True)
divlength_3 = DivideLength(Curve=graft_2, Length=0.4)  # -> simplify(Points), Tangents, Parameters
split_4 = SplitTree(Data=divlength_3.Points, Masks=flatten("{*;0}"))  # -> Positive, Negative
rev_2 = ReverseList(List=split_4.Positive)
merge = Merge(Data1=rev, Data2=split_2.Negative)
swatch = ColourSwatch(SwatchColor=RGB(255, 0, 0))
pline = PolyLine(Vertices=merge, Closed=False)
explode_6 = Explode(Curve=pline, Recursive=True)  # -> Segments, Vertices
flatten = FlattenTree(Tree=explode_6.Segments, Path="{0}")
split_5 = SplitList(List=flatten, Index=Slider(3255, range=0..3255))  # -> ListA, ListB
crv_9 = Curve(split_5.ListA)
pt_5 = Point(tracer_c.c)
merge_2 = Merge(Data1=rev_2, Data2=split_4.Negative)
join = JoinCurves(Curves=crv_9, Preserve=False)
crv_cp_4 = CurveClosestPoint(Point=pt_5, Curve=graft(join))  # -> Point, Parameter, Distance
swatch_2 = ColourSwatch(SwatchColor=RGB(255, 0, 0))
pipe_2 = Pipe(Curve=join, Radius=0.2, Caps=0)  # disabled
preview_4 = CustomPreview(Geometry=pipe_2, Material=swatch)  # disabled
pline_2 = PolyLine(Vertices=merge_2, Closed=False)
smaller = SmallerThan(FirstNumber=crv_cp_4.Distance, SecondNumber="0.01")  # -> SmallerThan, OrEqualTo
explode_7 = Explode(Curve=pline_2, Recursive=True)  # -> Segments, Vertices
flatten_2 = FlattenTree(Tree=explode_7.Segments, Path="{0}")
split_6 = SplitList(List=flatten_2, Index=Slider(972, range=0..3255))  # -> ListA, ListB
crv_10 = Curve(split_6.ListA)
cull = CullPattern(List=pt_5, CullPattern=smaller.SmallerThan)
pt_6 = Point(tracer_b.valid_seeds)
join_2 = JoinCurves(Curves=crv_10, Preserve=False)
crv_cp_5 = CurveClosestPoint(Point=pt_6, Curve=graft(join_2))  # -> Point, Parameter, Distance
curve_display = CSharpScript(Curve=join, Width="2", Colour=swatch)  # inputs Curve: Curve, Width: Int32, Colour: Color, Dash: String
# ---------- curve_display: C# ----------
    if (Curve == null) return;
    if (Width <= 0) return;

    double[] pattern = ParseDashPattern(Dash);
    IEnumerable<Curve> segments = ApplyDashPattern(Curve, pattern);

    _clip = BoundingBox.Union(_clip, Curve.GetBoundingBox(false));
    foreach (Curve segment in segments)
    {
      _curves.Add(segment);
      _colors.Add(Colour);
      _widths.Add(Width);
    }
# ---------- curve_display: C# additional code ----------
  /// <summary>
  /// Parse a dash pattern.
  /// </summary>
  /// <param name="pattern">Pattern to parse.</param>
  /// <returns>Array of dashes and gaps.</returns>
  private double[] ParseDashPattern(string pattern)
  {
    if (string.IsNullOrWhiteSpace(pattern))
      return null;

    string[] fragments = pattern.Split(new char[] {' '});
    if (fragments == null || fragments.Length == 0)
      return null;

    double[] values = new double[fragments.Length];
    for (int i = 0; i < fragments.Length; i++)
    {
      double v;
      if (!double.TryParse(fragments[i], out v))
        throw new Exception(fragments[i] + " is a not a valid number.");

      if (v <= 0.0)
        throw new Exception("Dashes or gaps must have a strictly positive length.");

      values[i] = v;
    }

    return values;
  }
  /// <summary>
  /// Apply a dash+gap pattern to a curve.
  /// </summary>
  private IEnumerable<Curve> ApplyDashPattern(Curve curve, double[] pattern)
  {
    if (pattern == null || pattern.Length == 0)
      return new Curve[] { curve };

    double curveLength = curve.GetLength();
    List<Curve> dashes = new List<Curve>();

    double offset0 = 0.0;
    int index = 0;
    while(true)
    {
      // Get the current dash length.
      double dashLength = pattern[index++];
      if (index >= pattern.Length)
        index = 0;

      // Compute the offset of the current dash from the curve start.
      double offset1 = offset0 + dashLength;
      if (offset1 > curveLength)
        offset1 = curveLength;

      // Solve the curve parameters at the current dash start and end.
      double t0, t1;
      curve.LengthParameter(offset0, out t0);
      curve.LengthParameter(offset1, out t1);

      Curve dash = curve.Trim(t0, t1);
      if (dash != null)
        dashes.Add(dash);

      // Get the current gap length.
      double gapLength = pattern[index++];
      if (index >= pattern.Length)
        index = 0;

      // Set the start of the next dash to be the end of the current
      // dash + the length of the adjacent gap.
      offset0 = offset1 + gapLength;

      // Abort when we've reached the end of the curve.
      if (offset0 >= curveLength)
        break;
    }

    return dashes;
  }

  private BoundingBox _clip;
  private readonly List<Curve> _curves = new List<Curve>();
  private readonly List<Color> _colors = new List<Color>();
  private readonly List<int> _widths = new List<int>();

  /// <summary>
  /// This method will be called once every solution, before any calls to RunScript.
  /// </summary>
  public override void BeforeRunScript()
  {
    _clip = BoundingBox.Empty;
    _curves.Clear();
    _colors.Clear();
    _widths.Clear();
  }

  /// <summary>
  /// Return a BoundingBox that contains all the geometry you are about to draw.
  /// </summary>
  public override BoundingBox ClippingBox
  {
    get { return _clip; }
  }
  /// <summary>
  /// Draw all wires and points in this method.
  /// </summary>
  public override void DrawViewportWires(IGH_PreviewArgs args)
  {
    for (int i = 0; i < _curves.Count; i++)
      args.Display.DrawCurve(_curves[i], _colors[i], _widths[i]);
  }
# ---------- end curve_display ----------
pipe_3 = Pipe(Curve=join_2, Radius=0.2, Caps=0)  # disabled
preview_5 = CustomPreview(Geometry=pipe_3, Material=swatch_2)  # disabled
sph_3 = Sphere(Base=cull, Radius=0.4)
smaller_2 = SmallerThan(FirstNumber=crv_cp_5.Distance, SecondNumber="0.01")  # -> SmallerThan, OrEqualTo
cull_2 = CullPattern(List=pt_6, CullPattern=smaller_2.SmallerThan)
preview_6 = CustomPreview(Geometry=sph_3, Material=ColourSwatch(SwatchColor=RGB(0, 0, 0)))
curve_display_2 = CSharpScript(Curve=join_2, Width="2", Colour=swatch_2)  # inputs Curve: Curve, Width: Int32, Colour: Color, Dash: String; same code as curve_display
sph_4 = Sphere(Base=cull_2, Radius=0.4)
preview_7 = CustomPreview(Geometry=sph_4, Material=ColourSwatch(SwatchColor=RGB(0, 0, 0)))
