# Grasshopper definition Topo_Tracer_example.gh (Grasshopper 1.0.8)
# plug-ins: Karamba3D, Pufferfish

pt = Point(Point(9, -6, 0))
xy = XYPlane(Origin=pt)
rectangle = Rectangle(Plane=xy, XSize=Domain(-1.5, 1.5), YSize=Domain(-2, 2), Radius=0)  # -> Rectangle, Length
boundary = BoundarySurfaces(Edges=rectangle.Rectangle)
crv = Curve(boundary)
mesh_uv = MeshSurface(Surface=boundary, UCount="100", VCount="100", Overhang=True, Equalize=False)
explode = Explode(Curve=crv, Recursive=True)  # -> Segments, Vertices
nv = NakedVertices(Mesh=mesh_uv)  # -> ClothedIndex, NakedIndex, ClothedPts, NakedPts
medges = MeshEdges(Mesh=mesh_uv)  # -> NakedEdges, InteriorEdges, NonManifoldEdges
disc = Discontinuity(Curve=rectangle.Rectangle, Level=1)  # -> Points, Parameters
crv_2 = Curve(medges.NakedEdges)
len = Length(Curve=medges.InteriorEdges)
len_2 = Length(Curve=crv_2)
vertexloads = VertexLoads(Mesh=mesh_uv, Strength="0.1")
anchor = Anchor(Point=disc.Points, Strength=1e+20)
multiplication = Multiplication(A=len, B=Slider(0.61, range=0..1))
multiplication_2 = Multiplication(A=len_2, B=Slider(0.05, range=0..1))
show = Show(G=mesh_uv)
length_line = LengthLine(Line=medges.InteriorEdges, Length=multiplication, Strength=500)
length_line_2 = LengthLine(Line=crv_2, Length=multiplication_2, Strength=6000)
solver = Solver(
    GoalObjects=flatten([length_line, anchor, vertexloads, show, length_line_2]),
    Reset=Button(),
    Threshold=1e-15,
    Tolerance=0.0001,
    On=Toggle(False))  # -> I, V, O
item = ListItem(
    List=[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, Line((7.525160363, -7.95212836, 0.02259761442), (7.556727554, -7.926153997, 0.04190555888)), Line((7.548730469, -7.905529616, 0.04421472519), (7.577848114, -7.882862743, 0.06233807666)), Line((7.570930813, -7.859964078, 0.06497011215), (7.598292067, -7.83978021, 0.0823235331)), Line((7.591921486, -7.81525979, 0.08494808127), (7.617936892, -7.79705492, 0.1017804103)), Line((7.611826121, -7.771286082, 0.1042123016), (7.636764385, -7.754722778, 0.1206872187))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],
    Index=0,
    Wrap=True)
demesh = DeconstructMesh(Mesh=item)  # -> Vertices, Faces, Colours, Normals
medges_2 = MeshEdges(Mesh=item)  # -> NakedEdges, InteriorEdges, NonManifoldEdges
crv_3 = Curve(medges_2.NakedEdges)
Z = UnitZ(Factor=Slider(-50, range=-60..9))
supp = SupportKaramba3D(PosInd=disc.Points, Ct_kN_m=Vector(0, 0, 0), Cr_kNm_rad=Vector(0, 0, 0), menu=[buttons(on, on, on, off, off, on)])
matselect = MaterialSelectionKaramba3D(menu=[dropdown(7), dropdown(4)])
loads = LoadsKaramba3D(Vector=Vector(0, 0, -1), LCase="LC0", mode="Gravity")
loads_2 = LoadsKaramba3D(Vector=Z, Mesh=item, LCase="LC0", mode="MeshLoad -Const.", menu=[buttons(off, on, off), buttons(on, on)])
load = LoadKaramba3D(flatten([loads, loads_2]))
crosec = CrossSectionKaramba3D(FamilyNameOfCrossSection="DefaultCroSec", Material=matselect, Height_cm="10", mode="Shell - Const")
surfelem = CreateSurfaceElementKaramba3D(Mesh=item, CrossSection=crosec, LimitDistance_m=5e-06, Bending=True, mode="MeshToShell")  # -> Element, Points, Info
license = LicenseKaramba3D()
assemble = AssembleModelKaramba3D(Elem=flatten(surfelem.Element), Support=flatten(supp), Load=flatten(load), LimitDistance_m=0.0005)  # -> Model, Info, Mass_kg, CentreOfGravity, LoadCaseNames
analyse = AnalyseKaramba3D(Model=assemble.Model)  # -> AnalysedModel, MaximumDisplacement_cm, ResultingForce_kN, ChangeOfElasticEnergy_kNm
modelview = ModelViewKaramba3D(Model=analyse.AnalysedModel)  # -> Model, DeformedMesh, DeformedAxes, DeformedModel, MaximumDeformation
shellview = ShellViewKaramba3D(Model=modelview.Model, IndexOfLayer=0)  # -> Model, MeshesOfRenderedShells, LegendColours, LegendTags
pop3d = Populate3D(Region=mesh_uv, Count=170, Seed=1)
shelllineresults = LineResultsOnShellsKaramba3D(
    AnalysedModel=analyse.AnalysedModel,
    LayerPosition=1,
    ListOfSourcesOfPrincipalStressLinesLinesPoints=pop3d,
    SegmentLength_m=0.5,
    DA_deg=5,
    mode="PrincStress")  # -> Model, Lines1, Lines2
shellvecresults = ResultVectorsOnShellsKaramba3D(Model=analyse.AnalysedModel, LayerPosition=1, mode="PrincStress")  # -> Model, Points, FirstPrincipalStressVector_kN_cm², SecondPrincipalStressVector_kN_cm², FirstPrincipalStressValue_kN_cm², SecondPrincipalStressValue_kN_cm²
crv_4 = Curve(shelllineresults.Lines1)
panel = Panel("300")
vec = Vector(shellvecresults.FirstPrincipalStressVector_kN_cm²)
vec_2 = Vector(shellvecresults.SecondPrincipalStressVector_kN_cm²)
msh2psrf = MeshToPolysurface(Mesh=item, Triangles=False, FaceMerge=False)
topo_tracer_no_1_2 = Python3Script(
    points=shellvecresults.Points,
    p1_list=vec,
    p2_list=vec_2,
    sigma1_list=shellvecresults.FirstPrincipalStressValue_kN_cm²,
    sigma2_list=shellvecresults.SecondPrincipalStressValue_kN_cm²,
    domain_surface=msh2psrf)  # -> singularities, new_seeds_1, field_1, new_seeds_2, field_2, dege_type, dege_index, a; inputs points: list of Point3d, p1_list: list of Vector3d, p2_list: list of Vector3d, sigma1_list: list of Double, sigma2_list: list of Double, domain_surface: Brep
# ---------- topo_tracer_no_1_2: Python ----------
neighbors = 10 #For partial derivative
tol_deg = 0.05 #Tolerance for degeneracy
offset_eps = 1 #For partial 
cluster_threshold = 0.1
seed_amplitude = 0.1
index_radius = 0.2
n_sep_merged = 4



from Topo_Tracer import Topo_Tracer_1
singularities, field_1, field_2, new_seeds_1, new_seeds_2, dege_index, dege_type = Topo_Tracer_1.main(domain_surface, points, sigma1_list, p1_list, sigma2_list, p2_list,tol_deg, offset_eps, neighbors, cluster_threshold, seed_amplitude, index_radius, n_sep_merged)
# ---------- end topo_tracer_no_1_2 ----------
join = JoinCurves(Curves=crv_3, Preserve=False)
topo_tracer_no_2_2 = Python3Script(
    seed_points=flatten(topo_tracer_no_1_2.new_seeds_1),
    principal_vectors=vec,
    points=shellvecresults.Points,
    domain_surface=msh2psrf,
    boundary_curves=join,
    seed_vectors=flatten(topo_tracer_no_1_2.field_1))  # -> a, b; inputs seed_points: list of Point3d, principal_vectors: list of Vector3d, points: list of Point3d, domain_surface: Brep, boundary_curves: list of Curve, seed_vectors: list of Vector3d
# ---------- topo_tracer_no_2_2: Python ----------
from Topo_Tracer import Topo_Tracer_2

k=25
h = 0.1
num_steps=1000
step_sign=1
boundary_tolerance=0.05
collision_threshold=0.05
n_back = 15
seed_dist = 0.05

a, b = Topo_Tracer_2.main(points, principal_vectors, seed_points, seed_vectors,boundary_curves, domain_surface, k, h, num_steps, step_sign , boundary_tolerance, collision_threshold, n_back, seed_dist)
# ---------- end topo_tracer_no_2_2 ----------
